# Grasshopper definition as1.gh (Grasshopper 1.0.8)

number_slider = Slider(-15, range=-15..100)
construct_domain = ConstructDomain(DomainStart=Slider(15, range=-15..100), DomainEnd=number_slider)
construct_domain_2 = ConstructDomain(DomainStart=Slider(15, range=-15..100), DomainEnd=Slider(-15, range=-15..100))
construct_domain_3 = ConstructDomain(DomainStart=Slider(-15, range=-15..100), DomainEnd=Slider(15, range=0..100))
construct_point = ConstructPoint(XCoordinate=0, YCoordinate=0, ZCoordinate=0)
domain_box = DomainBox(Base=PlaneXY(0, 0, 0), X=construct_domain_3, Y=construct_domain_2, Z=construct_domain)
line_sdl = LineSDL(Start=construct_point, Direction=Vector(0, 0, 1), Length=number_slider)
twist = Twist(Geometry=domain_box, Axis=line_sdl, Angle=degrees(Slider(95, range=0..100)), Infinite=False, Rigid=False)
deconstruct_brep = DeconstructBrep(Brep=twist)  # -> Faces, Edges, Vertices
mesh = Mesh(deconstruct_brep.Faces)
