# Grasshopper definition ass1.hops.gh (Grasshopper 1.0.8)

number6 = GetNumber(Slider(8, range=-15..100), AtLeast=1, AtMost=1, Maximum=1.797693135e+308, Minimum=-1.797693135e+308, TreeAccess=False)
number5 = GetNumber(Slider(6, range=-15..100), AtLeast=1, AtMost=1, Maximum=1.797693135e+308, Minimum=-1.797693135e+308, TreeAccess=False)
number3 = GetNumber(Slider(6, range=-15..100), AtLeast=1, AtMost=1, Maximum=1.797693135e+308, Minimum=-1.797693135e+308, TreeAccess=False)
number4 = GetNumber(Slider(8, range=-15..100), AtLeast=1, AtMost=1, Maximum=1.797693135e+308, Minimum=-1.797693135e+308, TreeAccess=False)
number2 = GetNumber(Slider(8, range=0..100), AtLeast=1, AtMost=1, Maximum=1.797693135e+308, Minimum=-1.797693135e+308, TreeAccess=False)
number1 = GetNumber(Slider(6, range=-15..100), AtLeast=1, AtMost=1, Maximum=1.797693135e+308, Minimum=-1.797693135e+308, TreeAccess=False)
series = Series(Start=0, Step=number3, Count=number4)
series_2 = Series(Start=0, Step=number5, Count=number6)
series_3 = Series(Start=0, Step=number1, Count=number2)
cross_reference = CrossReference(ListListA=series_3, ListListB=series, ListA=series_2, CrossMode=1)  # -> ListListA, ListListB, ListA
construct_point = ConstructPoint(XCoordinate=cross_reference.ListListA, YCoordinate=cross_reference.ListListB, ZCoordinate=cross_reference.ListA)
point = Point(Point(28.90012501, 31.22784922, 11.08073683))
point_2 = Point(construct_point)
distance = Distance(PointA=point_2, PointB=point)
smaller_than = SmallerThan(FirstNumber=distance, SecondNumber=Slider(20, range=0..100))  # -> SmallerThan, OrEqualTo
dispatch = Dispatch(List=point_2, DispatchPattern=smaller_than.OrEqualTo)  # -> ListA, ListB
point_3 = Point(dispatch.ListB)
point_4 = Point(dispatch.ListA)
center_box = CenterBox(Base=point_3, X=Slider(2, range=0..10), Y=Slider(2, range=0..10), Z=Slider(2, range=0..10))
geometry = Geometry(center_box)
context_bake = ContextBake(Content=geometry)
